# Grasshopper definition grid grasshopper-Yang Cen.gh (Grasshopper 1.0.7)
# plug-ins: Pufferfish

# ----
# 还不错啊鸽么
number_slider = Slider(10, range=0..10)
number_slider_2 = Slider(177, range=0..1000)
pt = ConstructPoint(XCoordinate=0, YCoordinate=0, ZCoordinate=0)
pt_2 = Point(pt)
Y = UnitY(Factor=1)
yz = YZPlane(Origin=pt_2)
line = LineSDL(Start=pt_2, Direction=Y, Length=number_slider_2)
rotate = Rotate(Geometry=line, Angle=degrees(Slider(60, range=0..100)), Plane=yz)  # -> Geometry, Transform
division = Division(A=Slider(75, range=0..100), B=number_slider_2)
eval = EvaluateCurve(Curve=reparameterize(rotate.Geometry), Parameter=division)  # -> Point, Tangent, Angle
offset = OffsetCurve(Curve=rotate.Geometry, Distance=number_slider, Plane=yz, Corners=1)
end = EndPoints(Curve=offset)  # -> Start, End
end_2 = EndPoints(Curve=rotate.Geometry)  # -> Start, End
crv_cp = CurveClosestPoint(Point=eval.Point, Curve=offset)  # -> Point, Parameter, Distance
end_3 = EndPoints(Curve=line)  # -> Start, End
ln = Line(StartPoint=crv_cp.Point, EndPoint=end.End)
ln_2 = Line(StartPoint=end_2.Start, EndPoint=eval.Point)
ln_3 = Line(StartPoint=eval.Point, EndPoint=crv_cp.Point)
ln_4 = Line(StartPoint=end.End, EndPoint=end_3.End)
merge = Merge(Data1=line, Data2=ln_2, Data3=ln_3, Data4=ln, Data5=ln_4)  # -> flatten(Result)
number_slider_3 = Slider(6.25, range=0..10)
join = JoinCurves(Curves=merge, Preserve=False)
boundary = BoundarySurfaces(Edges=join)
division_2 = Division(A=number_slider_3, B=2)
offsrf = OffsetSurface(Surface=boundary, Distance=number_slider_3, BothSides=0, CreateSolid=True)
X = UnitX(Factor=division_2)
move = Move(Geometry=offsrf, Motion=X)  # -> Geometry, Transform

宽度 = Slider(150, range=0..1000)
分段数 = Slider(4, range=0..10)
range = Range(Domain=宽度, Steps=分段数)
X_2 = UnitX(Factor=range)

分段数_2 = Slider(4, range=0..10)
宽度_2 = Slider(75, range=0..1000)
range_2 = Range(Domain=宽度_2, Steps=分段数_2)
X_3 = UnitX(Factor=range_2)

支架宽度方案选择 = Slider(1, range=0..1)
filter = StreamFilter(Gate=支架宽度方案选择, Stream0=X_2, Stream1=X_3)

divide = DivideCurve(Curve=line, Count=Slider(4, range=0..10), Kinks=False)  # -> Points, Tangents, Parameters
panel = Panel("""0
-1""")
cull_i = CullIndex(List=divide.Points, Indices=panel, Wrap=True)  # -> graft(List)
line_2 = LineSDL(Start=cull_i, Direction=Vector(0, 0, 1), Length=Slider(300, range=0..1000))
merge_2 = Merge(Data1=ln, Data2=ln_2, Data3=ln_3, Data4=ln_4)
join_2 = JoinCurves(Curves=merge_2, Preserve=False)
ccx = CurveCurve(CurveA=join_2, CurveB=line_2)  # -> flatten(Points), ParamsA, ParamsB
neg = Negative(Value=Slider(15, range=0..100))
Z = UnitZ(Factor=neg)
move_2 = Move(Geometry=ccx.Points, Motion=Z)  # -> graft(Geometry), Transform
filter_2 = StreamFilter(Gate=支架宽度方案选择, Stream0=宽度, Stream1=宽度_2)
X_4 = UnitX(Factor=1)
ln_5 = Line(StartPoint=simplify(cull_i), EndPoint=simplify(move_2.Geometry))
number_slider_4 = Slider(10, range=0..100)
line_3 = LineSDL(Start=cull_i, Direction=X_4, Length=filter_2)
neg_2 = Negative(Value=number_slider_4)
X_5 = UnitX(Factor=neg_2)
move_3 = Move(Geometry=ln_5, Motion=X_5)  # -> Geometry, Transform
ext = ExtendCurve(Curve=line_3, Type=0, Start=number_slider_4, End=number_slider_4)
extrcrv = ExtrudeAlong(Base=move_3.Geometry, Curve=ext)

move_4 = Move(Geometry=move.Geometry, Motion=filter)  # -> Geometry, Transform
offsrf_2 = OffsetSurface(Surface=extrcrv, Distance=number_slider_3, BothSides=0, CreateSolid=True)
merge_3 = Merge(Data1=move_4.Geometry, Data2=offsrf_2)
